# Grasshopper definition evaluate.gh (Grasshopper 1.0.7)
# plug-ins: Vox, Portal, Heteroptera

trigger = Trigger(Interval=-1000, TimerInterval=1000, Target=[file, file_3])
path = FilePath("F:\lab\3d-autoencoder\data\test\inference_0")
path_2 = FilePath("F:\lab\3d-autoencoder\output\inference\inference_output_thresholded.json")

# ---- group: Volume
box = Box({Plane=PlaneXY(0, 0, 0), X=Domain(-27.04713456, 42.93584143), Y=Domain(-23.45763848, 41.88845835), Z=Domain(0.01075653027, 62.99229233)})
center = Center(Geometry=box)  # -> Center, Dimension
scale = Scale(Geometry=box, Center=center.Center, Factor=Slider(1.5, range=0..10))  # -> Geometry, Transform

# ----
file = FileReader(FilePath=path)
write = Button()

# ----
# Evaluate with new geometry
subd = SubD(<subd referenced from the Rhino model>)
number_slider = Slider(3, range=0..10)
meshsubd = MeshFromSubD(SubD=subd, Density=2)
mesh = Mesh(meshsubd)
vec = VectorXYZ(XComponent=number_slider, YComponent=number_slider, ZComponent=number_slider)  # -> Vector, Length
box_2 = Box(scale.Geometry)
voxelsh = VoxelizeMeshSH(Mesh=mesh, VoxelSize=vec.Vector, Bounds=box_2)  # -> Voxels, VoxelSize, States
filter = VoxelFilter(VoxelPos=voxelsh.Voxels, VoxelSize=voxelsh.VoxelSize, States=voxelsh.States, TargetState=1)  # -> VoxelPos, VoxelSize
voxmesh = VoxelMesher(VoxelPos=filter.VoxelPos, VoxelSize=filter.VoxelSize, Algorithm=1)
nickname = SerializeVoxels(Voxels=voxelsh.Voxels, VoxelSize=voxelsh.VoxelSize, States=voxelsh.States, ExcludeSize=Toggle(False))
lng = ListLength(List=voxelsh.Voxels)
path_3 = FilePath("F:\lab\3d-autoencoder\data\test\")
item = ListItem(Index=0, Wrap=True)
concat = Concatenate(FragmentA=path_3, FragmentB="inference_", FragmentC=Slider(0, range=0..100))
panel = Panel(lng)
file_2 = FileWriter(Bytes=nickname, FilePath=concat, Write=write)

file_3 = FileReader(FilePath=path_2)
# Normalize
# Normalize
# Normalize
# Normalize
# Normalize
# Normalize
number_slider_2 = Slider(3, range=0..10)
number_slider_3 = Slider(3, range=0..10)
deb = BytesDecoder(Bytes=file)
deb_2 = BytesDecoder(Bytes=file_3)
nickname_2 = DeserializeVoxels(VStr=deb)  # -> Voxels, VoxelSize, States
nickname_3 = DeserializeVoxels(VStr=deb_2)  # -> Voxels, VoxelSize, States
vec_2 = VectorXYZ(XComponent=number_slider_2, YComponent=number_slider_2, ZComponent=number_slider_2)  # -> Vector, Length
vec_3 = VectorXYZ(XComponent=number_slider_3, YComponent=number_slider_3, ZComponent=number_slider_3)  # -> Vector, Length
filter_2 = VoxelFilter(VoxelPos=nickname_2.Voxels, VoxelSize=nickname_2.VoxelSize, States=nickname_2.States, TargetState=1)  # -> VoxelPos, VoxelSize
filter_3 = VoxelFilter(VoxelPos=nickname_3.Voxels, VoxelSize=nickname_3.VoxelSize, States=nickname_3.States, TargetState=1)  # -> VoxelPos, VoxelSize
lng_2 = ListLength(List=filter_2.VoxelPos)
lng_3 = ListLength(List=filter_3.VoxelPos)
dup = DuplicateData(Data=vec_2.Vector, Number=lng_2, Order=True)
dup_2 = DuplicateData(Data=vec_3.Vector, Number=lng_3, Order=True)
nickname_4 = NormalizeVoxels(Voxels=voxelsh.Voxels)
python = GhPythonScript(items=voxelsh.States)  # -> a; inputs items: list
# ---------- python: Python ----------
import rhinoscriptsyntax as rs

empty_count = 0
occupied_count = 0

for i in items:
    if i == 0:
        empty_count += 1
    elif i == 1:
        occupied_count +=1


a = occupied_count / len(items)
# ---------- end python ----------
voxmesh_2 = VoxelMesher(VoxelPos=filter_2.VoxelPos, VoxelSize=dup, Algorithm=Slider(1, range=0..10))
voxmesh_3 = VoxelMesher(VoxelPos=filter_3.VoxelPos, VoxelSize=dup_2, Algorithm=Slider(1, range=0..10))
preview = CustomPreview(Geometry=voxmesh_3, Material=ColourSwatch(SwatchColor=RGB(140, 115, 255)))
preview_2 = CustomPreview(Geometry=voxmesh_2, Material=ColourSwatch(SwatchColor=RGB(255, 164, 115)))
