# Grasshopper definition generate_data.gh (Grasshopper 1.0.7)
# plug-ins: Chimera, Heteroptera, Vox, Portal, Pufferfish

interval = Slider(50, range=50..15000)
pipeline = GeometryPipeline(
    GroupByLayer=False,
    GroupByType=False,
    IncludeHidden=True,
    IncludeLocked=True,
    LayerFilter="meshes",
    NameFilter="*",
    SublayerFiltering=True,
    TypeFilter=32)

# ---- group: Master iterator
toggle = BooleanToggle(False)
counter = MK_Counter(Run=toggle, StartNumber=0, TargetNumber=Slider(10000, range=0..10000), Interval=interval)

# ----
lng = ListLength(List=pipeline)
x_minus_one = XMinusOne(NumberX=lng)
python = GhPythonScript(counter=counter)  # -> seed
# ---------- python: Python ----------
import rhinoscriptsyntax as rs
import random

seed = random.randint(0,100000)
# ---------- end python ----------

# ---- group: Mesh Selection
cluster = Cluster(A=0, B=x_minus_one, N=1, S=python)
item = ListItem(List=pipeline, Index=cluster, Wrap=True)

# ----
center = Center(Geometry=item)  # -> Center, Dimension
python_2 = GhPythonScript(counter=python)  # -> seed; same code as python
python_3 = GhPythonScript(counter=python)  # -> seed; same code as python

# ---- group: Rotation
neg = Negative(Value="1")
cluster_2 = Cluster(A=neg, B="1", N=Slider(3, range=0..10), S=python_2)
item_2 = ListItem(List=cluster_2, Index=0, Wrap=True)  # -> Item, Item1, Item2
cluster_3 = Cluster(A="-180", B="180", N=1, S=python_3)
vec = VectorXYZ(XComponent=item_2.Item, YComponent=item_2.Item1, ZComponent=item_2.Item2)  # -> Vector, Length
rot3d = Rotate3D(Geometry=item, Angle=degrees(cluster_3), Center=center.Center, Axis=vec.Vector)  # -> Geometry, Transform

# ----
python_4 = GhPythonScript(counter=python)  # -> seed; same code as python

# ---- group: Scale
cluster_4 = Cluster(A="0.8", B="1.5", N=1, S=python_4)
scale = Scale(Geometry=rot3d.Geometry, Center=center.Center, Factor=cluster_4)  # -> Geometry, Transform

# ----
python_5 = GhPythonScript(counter=python)  # -> seed; same code as python

# ---- group: Translation
python_6 = GhPythonScript(counter=python)  # -> seed; same code as python
neg_2 = Negative(Value="1")
cluster_5 = Cluster(A=neg_2, B="1", N=Slider(3, range=0..10), S=python_6)
item_3 = ListItem(List=cluster_5, Index=0, Wrap=True)  # -> Item, Item1, Item2
cluster_6 = Cluster(A=0, B="30", N=1, S=python_5)
vec_2 = VectorXYZ(XComponent=item_3.Item, YComponent=item_3.Item1, ZComponent=item_3.Item2)  # -> Vector, Length
amp = Amplitude(Vector=vec_2.Vector, Amplitude=cluster_6)
move = Move(Geometry=scale.Geometry, Motion=amp)  # -> Geometry, Transform

# ---- group: Deformation
python_7 = GhPythonScript(counter=python)  # -> seed; same code as python
python_8 = GhPythonScript(counter=python)  # -> seed; same code as python
cluster_7 = Cluster(A=0, B="5", N=1, S=python_7)
demesh = DeconstructMesh(Mesh=move.Geometry)  # -> Vertices, Faces, Colours, Normals
popgeo = PopulateGeometry(Geometry=move.Geometry, Count=cluster_7, Seed=python_8)
cp = ClosestPoint(Point=demesh.Vertices, Cloud=popgeo)  # -> ClosestPoint, CPIndex, Distance
bnd = Bounds(Numbers=cp.Distance)
remap = RemapNumbers(Value=cp.Distance, Source=bnd, Target=Domain(0, 1))  # -> Mapped, Clipped
python_9 = GhPythonScript(counter=python)  # -> seed; same code as python
graph = GraphMapper(
    remap.Mapped,
    x0=0,
    x1=1,
    y0=0,
    y1=1,
    container_name="Bezier",
    cpx=[0, 0.686506927, 0.2410549074, 1],
    cpy=[1, 0.777626574, 0.3535505533, 0])
cluster_8 = Cluster(A=0, B="8", N=1, S=python_9)
multiplication = Multiplication(A=graph, B=cluster_8)
multiplication_2 = Multiplication(A=demesh.Normals, B=multiplication)
move_2 = Move(Geometry=demesh.Vertices, Motion=multiplication_2)  # -> Geometry, Transform
conmesh = ConstructMesh(Vertices=move_2.Geometry, Faces=demesh.Faces)

# ----
cluster_9 = Cluster(A=0, B=1, N=1, S=2)

# ---- group: Volume
box = Box({Plane=PlaneXY(0, 0, 0), X=Domain(-27.04713456, 42.93584143), Y=Domain(-23.45763848, 41.88845835), Z=Domain(0.01075653027, 62.99229233)})
center_2 = Center(Geometry=box)  # -> Center, Dimension
scale_2 = Scale(Geometry=box, Center=center_2.Center, Factor=Slider(1.5, range=0..10))  # -> Geometry, Transform

# ---- group: Voxel export
number_slider = Slider(5, range=0..10)
vec_3 = VectorXYZ(XComponent=number_slider, YComponent=number_slider, ZComponent=number_slider)  # -> Vector, Length
voxelsh = VoxelizeMeshSH(Mesh=conmesh, VoxelSize=vec_3.Vector, Bounds=scale_2.Geometry)  # -> Voxels, VoxelSize, States, VoxelGrid
toggle_2 = BooleanToggle(False)
lng_2 = ListLength(List=voxelsh.Voxels)
path = FilePath("F:\lab\3d-autoencoder\data\raw\")
concat = Concatenate(FragmentA=path, FragmentB="voxels_", FragmentD=lng_2, FragmentE="_", FragmentC=counter)

# ----
serializevoxelgrid = SerializeVoxelGrid(VoxelGrid=voxelsh.VoxelGrid, ExtractParts=Slider(2, range=0..10))  # -> Serialized1D, Serialized3D
voxel_dimension = Panel(lng_2)

# ---- group: Voxel export (continued)
enb = BytesEncoder(Text=serializevoxelgrid.Serialized1D, Compress=False)
file = FileWriter(Bytes=enb, FilePath=concat, Write=toggle)

# ==== cluster Cluster
A = ClusterInput()
B = ClusterInput()
N = ClusterInput()
S = ClusterInput()
dom = ConstructDomain(DomainStart=A, DomainEnd=B)
random = Random(Range=dom, Number=N, Seed=S, Integers=False)
R = ClusterOutput(random)
